# Dynamo graph Sample_Script.dyn (Dynamo 0.9.2.4461)

NSTest = DotsDynamo.NSTest.NSTest()
number_slider = DoubleSlider(37, range=0..100 step 0.1)
number_slider_2 = DoubleSlider(27.6, range=0..100 step 0.1)
sum = DotsDynamo.NSTest.Sum(NSTest, number_slider, number_slider_2)
watch = Watch(sum)
integer_slider = IntegerSlider(4, range=0..10 step 1)
getDotsFromDB = DotsDynamo.NSTest.GetDotsFromDB(NSTest, integer_slider)
watch_2 = Watch(getDotsFromDB)
code_block = CodeBlock {  }
